# Grasshopper definition surface_path_planner_fabrication.ghx (Grasshopper 1.0.7)
# plug-ins: NGon

# ----
# Mesh definition
swatch = ColourSwatch(SwatchColor=RGB(255, 0, 0))
input_mesh = Mesh(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)
mesh_curvature = MeshCurvature(
    Mesh=input_mesh,
    CurvatureType=5,
    Radius=3,
    Method=1,
    Interval=Domain(0, 0),
    _3Colors=[swatch, ColourSwatch(SwatchColor=RGB(255, 255, 0)), ColourSwatch(SwatchColor=RGB(0, 255, 255))],
    On=True)  # -> Mesh, CurvatureValues
bnd = Bounds(Numbers=mesh_curvature.CurvatureValues)
remap = RemapNumbers(Value=mesh_curvature.CurvatureValues, Source=bnd, Target=Domain(0, 1))  # -> Mapped, Clipped
gradient = Gradient(
    LowerLimit=0,
    UpperLimit=1,
    Parameter=remap.Mapped,
    stops=[0: RGB(128, 255, 255), 0.5: RGB(255, 255, 0), 1: RGB(255, 0, 0)])
mcol = MeshColours(Mesh=input_mesh, Colours=gradient)

# ----
# Path planner
path_type = ValueList({"Lowest Axis Path": 1, "Lowest Axis Path Combined": 2, "Lowest Axis Path Priority": 3, "Lowest Axis Path Adjusted": 4, "Centroid Path": 5, "Boundary Path": 6, "Corners Path": 7, "Random Path Adjusted": 8, "Lowest Neighbors Path": 9}, selected="Lowest Axis Path")
orientation = ValueList({"X-axis": "x", "Y-axis": "y", "Z-axis": "z"}, selected="Y-axis")
tool_path_planning = GhPythonScript(compute=Button(), path_type=path_type, orientation=orientation, mesh=mcol)  # -> planner, points, edges, n, planes
# ---------- tool_path_planning: Python ----------
import compas
from compas_rhino.geometry import RhinoMesh
from robotic_knitcrete.surface_path_planner import SurfacePathPlanner
from robotic_knitcrete.planner_mesh import PlannerMesh
from compas_ghpython.utilities import draw_network, draw_frame
import ghpythonlib.components as ghcomp
from compas.colors import Color
import time

rmesh = RhinoMesh.from_guid(mesh)
planner = SurfacePathPlanner()
planner.set_quad_mesh_from_rhinomesh(rmesh)
planner.set_network_nodes()
#planner.set_color_map([
#    Color.from_rgb255(128,255,255),
#    Color.from_rgb255(255,255,0),
#    Color.from_rgb255(255,0,0)])
#planner.set_thickness_map([
#    0.008,
#    0.010,
#    0.012])


if path_type == 1:
    [network, n] = planner.lowest_axis_path(orientation)

#planner.calculate_fabrication_parameters()

points, edges = draw_network(network)   
planes = []
tool_planes = []
cylinders = []
colors = []
for k in planner.network.path:
    frame = planner.network.node_attribute(key=k, name='frame')
    plane = draw_frame(frame)
    planes.append(plane)
    
print(planner.network.node_attributes(key=0))
# ---------- end tool_path_planning ----------
pt = Point(tool_path_planning.points)
path = Curve(tool_path_planning.edges)
panel = Panel(tool_path_planning.n)

unload_modules = GhPythonScript(reload=Button())
# ---------- unload_modules: Python ----------
if reload:
    from compas_ghpython import unload_modules
    unload_modules('robotic_tufting')
    unload_modules('robotic_knitcrete')
# ---------- end unload_modules ----------

# ----
# Fabrication Parameters
number_slider = Slider(0.008, range=0..0.05)
fabrication_settings = GhPythonScript(
    set=Toggle(True),
    planner=tool_path_planning.planner,
    material_flowrate=Slider(500, range=0..1000),
    thickness_range=[Slider(0.008, range=0..0.05), Slider(0.022, range=0..0.05)],
    radius_range=[Slider(0.04, range=0..0.1), Slider(0.075, range=0..0.1)],
    distance_range=[Slider(0.1, range=0..1), Slider(0.3, range=0..1)],
    measured_radii=[Slider(0.04, range=0..0.1), Slider(0.075, range=0..0.1)],
    measured_distances=[Slider(0.1, range=0..1), Slider(0.3, range=0..1)],
    measured_thicknesses=[number_slider, Slider(0.022, range=0..0.05)])  # -> out, planner; inputs thickness_range: list, radius_range: list, distance_range: list, measured_radii: list, measured_distances: list, measured_thicknesses: list
# ---------- fabrication_settings: Python ----------
fabrication_parameters = {
    'material_flowrate':material_flowrate,
    'thickness_range':thickness_range,
    'radius_range':radius_range,
    'distance_range':distance_range,
    'measured_radii':measured_radii,
    'measured_distances':measured_distances,  
    'measured_thicknesses':measured_thicknesses
}

if set:
    planner.fabrication_parameters.update(fabrication_parameters)
# ---------- end fabrication_settings ----------

# ----
# Calculate fabrication
# parameters
thickness_gradient = Panel("""0.008
0.010
0.012""")
color_gradient = Panel("""[128,255,255]
[255,255,0]
[255,0,0]""")
calculate_fabrication_parameters = GhPythonScript(calculate=Button(), planner=fabrication_settings.planner, colors=color_gradient, thicknesses=thickness_gradient)  # -> out, planner; inputs colors: list, thicknesses: list
# ---------- calculate_fabrication_parameters: Python ----------
from compas.colors import Color

colors_eval = [eval(n) for n in colors]
ccolors = [Color.from_rgb255(c[0], c[1], c[2]) for c in colors_eval]

if calculate:
    planner.set_color_map(ccolors)
    planner.set_thickness_map(thicknesses)
    planner.calculate_fabrication_parameters()
# ---------- end calculate_fabrication_parameters ----------

visualization = GhPythonScript(planner=calculate_fabrication_parameters.planner)  # -> out, planes, tool_planes, radii, velocities, distances, warnings
# ---------- visualization: Python ----------
from compas_ghpython.utilities import draw_frame

planes = []
tool_planes = []
radii = []
velocities = []
distances = []
warnings = []
for k in planner.network.path:
    frame = planner.network.node_attribute(key=k, name='frame')
    tool_frame = planner.network.node_attribute(key=k, name='tool_frame')
    plane = draw_frame(frame)
    tool_plane = draw_frame(tool_frame)
    planes.append(plane)
    tool_planes.append(tool_plane)
    r = planner.network.node_attribute(key=k, name='radius')
    radii.append(r)
    if (r < planner.fabrication_parameters['radius_range'][0]
        or r > planner.fabrication_parameters['radius_range'][1]):
        warnings.append("Node {} radius is out of range!".format(k))
    velocities.append(planner.network.node_attribute(key=k, name='velocity'))
    d = planner.network.node_attribute(key=k, name='distance')
    distances.append(d)
    if (d < planner.fabrication_parameters['distance_range'][0]
        or d > planner.fabrication_parameters['distance_range'][1]):
        warnings.append("Node {} distance is out of range!".format(k))
# ---------- end visualization ----------
planes = Geometry(visualization.tool_planes)
panel_2 = Panel(visualization.warnings)

# ----
# Simulation counter
knob = ControlKnob(Decimals=0, Limit=True, Maximum=2000, Minimum=0, Range=25, Value=0)
item = ListItem(List=planes, Index=knob, Wrap=True)

# ----
# Shotcrete Nozzle Tool (End-effector)
number_slider_2 = Slider(0.2, range=0..1)
mesh = Mesh(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)
pt_2 = Point(Point(0, 0.55, 0.1065010352))
panel_3 = Panel("149")
Y = UnitY(Factor=number_slider_2)
move = Move(Geometry=pt_2, Motion=Y)  # -> Geometry, Transform
xz = XZPlane(Origin=move.Geometry)
cone = Cone(Base=xz, Radius=Slider(0.06, range=0..1), Length=number_slider_2)  # -> Cone, Tip
merge = Merge(Data1=mesh, Data2=cone.Cone)
orient = Orient(Geometry=merge, Source=xz, Target=item)  # -> Geometry, Transform

preview = CustomPreview(Geometry=input_mesh, Material=ColourSwatch(SwatchColor=RGB(143, 143, 143)))
preview_2 = CustomPreview(Geometry=orient.Geometry, Material=ColourSwatch(SwatchColor=RGB(227, 227, 227)))
