# Grasshopper definition surface_path_planning.ghx (Grasshopper 1.0.7)
# plug-ins: NGon

unload_modules = GhPythonScript(reload=Button())
# ---------- unload_modules: Python ----------
if reload:
    from compas_ghpython import unload_modules
    unload_modules('robotic_tufting')
    unload_modules('robotic_knitcrete')
# ---------- end unload_modules ----------
input_mesh = Mesh(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)
mesh_curvature = MeshCurvature(
    Mesh=input_mesh,
    CurvatureType=5,
    Radius=3,
    Method=1,
    Interval=Domain(0, 0),
    _3Colors=[ColourSwatch(SwatchColor=RGB(255, 0, 0)), ColourSwatch(SwatchColor=RGB(255, 255, 0)), ColourSwatch(SwatchColor=RGB(0, 255, 255))],
    On=True)  # -> Mesh, CurvatureValues
bnd = Bounds(Numbers=mesh_curvature.CurvatureValues)
remap = RemapNumbers(Value=mesh_curvature.CurvatureValues, Source=bnd, Target=Domain(0, 1))  # -> Mapped, Clipped
gradient = Gradient(
    LowerLimit=0,
    UpperLimit=1,
    Parameter=remap.Mapped,
    stops=[0: RGB(128, 255, 255), 0.5: RGB(255, 255, 0), 1: RGB(255, 0, 0)])
path_type = ValueList({"Lowest Axis Path": 1, "Lowest Axis Path Combined": 2, "Lowest Axis Path Priority": 3, "Lowest Axis Path Adjusted": 4, "Centroid Path": 5, "Boundary Path": 6, "Corners Path": 7, "Random Path Adjusted": 8, "Lowest Neighbors Path": 9}, selected="Lowest Axis Path")
orientation = ValueList({"X-axis": "x", "Y-axis": "y", "Z-axis": "z"}, selected="Y-axis")
mcol = MeshColours(Mesh=input_mesh, Colours=gradient)
tool_path_planning = GhPythonScript(compute=Button(), path_type=path_type, orientation=orientation, mesh=mcol)  # -> points, edges, n, planes, tool_planes, cylinders, colors
# ---------- tool_path_planning: Python ----------
import compas
from compas_rhino.geometry import RhinoMesh
from robotic_knitcrete.surface_path_planner import SurfacePathPlanner
from robotic_knitcrete.planner_mesh import PlannerMesh
from compas_ghpython.utilities import draw_network, draw_frame
import ghpythonlib.components as ghcomp
from compas.colors import Color
import time

rmesh = RhinoMesh.from_guid(mesh)
planner = SurfacePathPlanner()
planner.set_quad_mesh_from_rhinomesh(rmesh)
planner.set_network_nodes()
planner.set_color_map([
    Color.from_rgb255(128,255,255),
    Color.from_rgb255(255,255,0),
    Color.from_rgb255(255,0,0)])
planner.set_thickness_map([
    0.008,
    0.010,
    0.012])


if path_type == 1:
    [network, n] = planner.lowest_axis_path(orientation)

planner.calculate_fabrication_parameters()

points, edges = draw_network(network)   
planes = []
tool_planes = []
cylinders = []
colors = []
for k in planner.network.path:
    frame = planner.network.node_attribute(key=k, name='frame')
    tool_frame = planner.network.node_attribute(key=k, name='tool_frame')
    plane = draw_frame(frame)
    tool_plane = draw_frame(tool_frame)
    planes.append(plane)
    tool_planes.append(tool_plane)
    cylinder = ghcomp.Cylinder(plane,planner.network.node_attribute(key=k, name='radius'), planner.network.node_attribute(key=k, name='thickness'))
    cylinders.append(ghcomp.CapHoles(cylinder))
    r,g,b = planner.node_color(k)
    colors.append(ghcomp.ColourRGB(alpha=255, red=r,green=g,blue=b))
    
print(planner.network.node_attributes(key=0))
# ---------- end tool_path_planning ----------
panel = Panel(tool_path_planning.n)
pt = Point(tool_path_planning.points)
path = Curve(tool_path_planning.edges)
preview = CustomPreview(Geometry=tool_path_planning.cylinders, Material=tool_path_planning.colors)
planes = Geometry(tool_path_planning.tool_planes)

# ----
# Simulation counter
knob = ControlKnob(Decimals=0, Limit=True, Maximum=2000, Minimum=0, Range=25, Value=0)
item = ListItem(List=planes, Index=knob, Wrap=True)

# ----
# Shotcrete Nozzle Tool (End-effector)
number_slider = Slider(0.2, range=0..1)
mesh = Mesh(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)
pt_2 = Point(Point(0, 0.55, 0.1065010352))
panel_2 = Panel("149")
Y = UnitY(Factor=number_slider)
move = Move(Geometry=pt_2, Motion=Y)  # -> Geometry, Transform
xz = XZPlane(Origin=move.Geometry)
cone = Cone(Base=xz, Radius=Slider(0.06, range=0..1), Length=number_slider)  # -> Cone, Tip
merge = Merge(Data1=mesh, Data2=cone.Cone)
orient = Orient(Geometry=merge, Source=xz, Target=item)  # -> Geometry, Transform

preview_2 = CustomPreview(Geometry=orient.Geometry, Material=ColourSwatch(SwatchColor=RGB(227, 227, 227)))
preview_3 = CustomPreview(Geometry=input_mesh, Material=ColourSwatch(SwatchColor=RGB(143, 143, 143)))
