# Grasshopper definition 220705_CDF_FormFinding_A.gh (Grasshopper 1.0.7)
# Copyright: Felswind
# plug-ins: EQlib, Karamba3D

# ----
# 0 - Input
border_curves = Curve([<curve referenced from the Rhino model> x4])
holes = Curve([<curve referenced from the Rhino model> x3])

holes_ind_move = Panel("""0
1
2""")
holes_heigth = Panel("""0
0
1.4""")

gradient = Gradient(
    LowerLimit=0,
    UpperLimit=9,
    Parameter=[0, 1, 2, 3, 4, 5, 6, 7, 8, 9],
    stops=[0.0661: RGB(255, 255, 255), 0.467: RGB(0, 0, 0)])

# ----
# 1 - Mesh Generation
mesh_with_holes = MeshWithHoles(curves=border_curves, base=holes)  # -> list, base_mesh_2, curves_2
qrsettings = QuadRemeshSettings(TargetCount=3000, AdaptiveSize=0, AdaptiveCount=False, HardEdges=False, SeamEdges=1, Symmetry=0, GuideCurves=2)
qrmesh = QuadRemesh(Mesh=mesh_with_holes.base_mesh_2, Guides=mesh_with_holes.list, Settings=qrsettings)

curve_middle = CurveMiddle(Curve=mesh_with_holes.curves_2)
points = PointList(Points=curve_middle, Size=0.5)
move_the_holes_up = GhPythonScript(mesh=qrmesh, holes=mesh_with_holes.curves_2, hole_indices=holes_ind_move, hole_heights=holes_heigth, tolerance=0.01)  # -> out, mesh; inputs mesh: Mesh, holes: list of Curve, hole_indices: list of Int32, hole_heights: list
# ---------- move_the_holes_up: Python ----------
__author__ = "Thomas Oberbichler"

from Rhino.Geometry import *

mesh = mesh.DuplicateMesh()

for i, z in zip(hole_indices, hole_heights):
    hole = holes[i]
    
    for j, vertex in enumerate(mesh.Vertices):
        point = Point3d(vertex.X, vertex.Y, vertex.Z)
        success, t = hole.ClosestPoint(point, tolerance)
        
        if success:
            mesh.Vertices[j] = Point3f(vertex.X, vertex.Y, z)
# ---------- end move_the_holes_up ----------

quad_remesh = QuadRemesh(Mesh=move_the_holes_up.mesh, Guides=mesh_with_holes.list, Settings=qrsettings)
mesh_edges = MeshEdges(Mesh=quad_remesh)  # -> NakedEdges, InteriorEdges, NonManifoldEdges
join_curves = JoinCurves(Curves=mesh_edges.NakedEdges, Preserve=False)
mesh = Mesh(quad_remesh)

cp = ControlPoints(Curve=join_curves)  # -> Points, Weights, Knots

# ----
# 2 - Supports
point = Point(cp.Points)
mid_anchor = MidAnchor(list=mesh_edges.InteriorEdges, vector=mesh_edges.InteriorEdges, curve=mesh_with_holes.list)
support = EqNodalSupport(Location=flatten([point, mid_anchor]), FixX=True, FixY=True, FixZ=True)

# ----
# 2 - Prestressing Border
number_slider = Slider(0.3, range=0..1)
border_edges = Curve(join_curves)
len = Length(Curve=border_edges)
multiplication = Multiplication(A=len, B=number_slider)
truss = EqTruss(Geometry=border_edges, Material=Slider(100, range=0..1000), Prestress=0, ReferenceLength=multiplication, Strategy=0)

# ----
# 2 - Fabric Prestressing
number_slider_2 = Slider(0.2, range=0..1)
inner_edges = Curve(mesh_edges.InteriorEdges)
len_2 = Length(Curve=inner_edges)
multiplication_2 = Multiplication(A=len_2, B=number_slider_2)
truss_2 = EqTruss(Geometry=inner_edges, Material=Slider(100, range=0..1000), Prestress=0, ReferenceLength=multiplication_2, Strategy=0)

# ----
# 2 - Self-weight
number_slider_3 = Slider(0, range=0..100000)
Z = UnitZ(Factor=number_slider_3)
neg = Negative(Value=Z)
load = EqSurfaceLoad(Geometry=mesh, Load=neg)

# ----
# 2 - Dummy-mesh for visualization
membrane = EqMembrane(Geometry=mesh, Thickness=1, Strategy=0)

# ----
# 3 - Simulation
model = EqModel(Elements=flatten([support, truss, truss_2, membrane, load]), Tolerance=-1)
trigger = Trigger(Interval=1000, TimerInterval=1000, Target=newtonsolver)  # disabled
newtonsolver = EqNewtonRaphsonSolver(Model=model, Damping=0, MaximumIterations=1, ResidualTolerance=1e-05)  # -> Model, ResidualNorm
geometry = EqExtractGeometry(Model=newtonsolver.Model, Elements=membrane)
preview = CustomPreview(Geometry=geometry, Material=ColourSwatch(SwatchColor=RGBA(112, 112, 112, 100)))

# ----
# 4 - Visualization
cluster = Cluster(mesh=mesh, mesh_2=geometry)  # -> start, end, result, interior_edges
gradient_2 = Gradient(
    LowerLimit=cluster.start,
    UpperLimit=cluster.end,
    Parameter=cluster.result,
    stops=[0: RGB(0, 128, 0), 0.5: RGB(255, 255, 0), 1: RGB(255, 0, 0)])
preview_2 = CustomPreview(Geometry=cluster.interior_edges, Material=gradient_2)

# ----
# 05 - Input Mesh
input_mesh = Mesh(geometry)
get_anchor_z = GhPythonScript(mesh=input_mesh)  # -> anchor_points; inputs mesh: Mesh
# ---------- get_anchor_z: Python ----------
import ghpythonlib.components as gh

tol = 0.00001
pts = gh.DeconstructMesh(mesh)[0]

anchor_points = []
for pt in pts:
    if pt[2] < tol: anchor_points.append(pt)
# ---------- end get_anchor_z ----------

# ----
# 06 - Structural Model
shell_thickness = Slider(5, range=0..20)
cross_section_karamba3d = CrossSectionKaramba3D(
    FamilyNameOfCrossSection="DefaultCroSec",
    Material=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,
    Height_cm=shell_thickness,
    mode="Shell - Const")
material_selection_karamba3d = MaterialSelectionKaramba3D(menu=[dropdown(7), dropdown(5)])
support_karamba3d = SupportKaramba3D(PosInd=get_anchor_z, menu=[buttons(on, on, on, off, off, off)])
mesh_to_shell_karamba3d = MeshToShellKaramba3D(Mesh=input_mesh, LimitDistance_m=0.005)  # -> Element, Points, Info
loads_karamba3d = LoadsKaramba3D(Vector=Vector(0, 0, -1), LCase="0", mode="Gravity")
assemble_model_karamba3d = AssembleModelKaramba3D(
    Elem=mesh_to_shell_karamba3d.Element,
    Support=support_karamba3d,
    Load=loads_karamba3d,
    CrossSection=cross_section_karamba3d,
    Material=material_selection_karamba3d,
    LimitDistance_m=0.005)  # -> Model, Info, Mass_kg, CenterOfGravity, LoadCaseNames

# ----
# 07 - Structural FEM Analysis
analyze_karamba3d = AnalyzeKaramba3D(Model=assemble_model_karamba3d.Model)  # -> CalculatedModel, MaximumDisplacement_cm, ResultingForceOfGravity_kN, ElasticEnergyChange_kNm
maximum_displacement_cm = Panel(analyze_karamba3d.MaximumDisplacement_cm)

# ----
# 08 - Structural FEM Analysis Results
gradient_3 = Gradient(
    LowerLimit=0,
    UpperLimit=9,
    Parameter=[0, 1, 2, 3, 4, 5, 6, 7, 8, 9],
    stops=[0: RGB(0, 0, 255), 0.348: RGB(100, 100, 255), 0.499: RGB(224, 224, 224), 0.648: RGB(255, 100, 100), 1: RGB(255, 0, 0)])
model_view_karamba3d = ModelViewKaramba3D(Model=analyze_karamba3d.CalculatedModel, ResultFactors=1, ResultCase=-1, Colors=gradient)  # -> Model, DeformedMesh, DeformedAxes, DeformedModel

# ----
# 09 - Visualisation
shell_view_karamba3d = ShellViewKaramba3D(Model=model_view_karamba3d.Model, IndexOfLayer=0)  # -> Model, MeshesOfRenderedShells, LegendColors, LegendTags
mesh_2 = Mesh(shell_view_karamba3d.MeshesOfRenderedShells)
legend = Legend(Colour=shell_view_karamba3d.LegendColors, Tags=shell_view_karamba3d.LegendTags, LegendType=101)
deconstruct_mesh = DeconstructMesh(Mesh=mesh_2)  # -> Vertices, Faces, Colours, Normals

# ==== cluster MeshWithHoles

curves = ClusterInput()
base = ClusterInput()

# ---- group: Ordering
flip = GhPythonScript(curves=curves)  # -> curves_flipped; inputs curves: list of Curve
# ---------- flip: Python ----------
import ghpythonlib.components as gh

curves_flipped = []

for crv in curves:
    
    curve_x = gh.Vector2Pt(gh.EndPoints(crv)[0], gh.EndPoints(crv)[1], False)[0][0]
    
    if curve_x > 0: curves_flipped.append(gh.FlipCurve(crv)[0])
    else: curves_flipped.append(crv)
# ---------- end flip ----------
evaluate_curve = EvaluateCurve(Curve=reparameterize(flip), Parameter=0)  # -> Point, Tangent, Angle
deconstruct = Deconstruct(Point=evaluate_curve.Point)  # -> XComponent, YComponent, ZComponent
panel = Panel("""0
-1""")
sort_list = SortList(Keys=deconstruct.YComponent, ValuesValuesA=flip)  # -> Keys, ValuesValuesA
loft_options = LoftOptions(Closed=False, Adjust=False, Rebuild=100, Refit=0, Type=0)

# ----
loft = Loft(Curves=flatten(sort_list.ValuesValuesA), Options=loft_options)
bounding_box = BoundingBox(Content=loft, Plane=PlaneXY(0, 0, 0))  # -> Box, Box_2
deconstruct_box = DeconstructBox(Box=bounding_box.Box)  # -> Plane, X, Y, Z
deconstruct_domain = DeconstructDomain(Domain=deconstruct_box.Z)  # -> Start, End
unit_z = UnitZ(Factor=expr("x*1.1", deconstruct_domain.End))
extrude = Extrude(Base=base, Direction=unit_z)
cull_index = CullIndex(List=sort_list.ValuesValuesA, Indices=panel, Wrap=True)
brep_brep = BrepBrep(BrepA=loft, BrepB=extrude)  # -> flatten(Curves), Points
split_brep_multiple = SplitBrepMultiple(Brep=loft, Cutters=extrude)
area = Area(Geometry=split_brep_multiple)  # -> Area, Centroid
sort_list_2 = SortList(Keys=area.Area, ValuesValuesA=split_brep_multiple)  # -> Keys, ValuesValuesA
list_item = ListItem(List=sort_list_2.ValuesValuesA, Index=-1, Wrap=True)
base_mesh = Mesh(list_item)

base_mesh_2 = ClusterOutput(base_mesh)
curves_2 = ClusterOutput(brep_brep.Curves)
list = ClusterOutput(cull_index)

# ==== cluster MidAnchor
vector = ClusterInput()
vector_2 = Vector(vector)
deconstruct_vector = DeconstructVector(Vector=vector_2)  # -> XComponent, YComponent, ZComponent
expression = Expression(x=deconstruct_vector.XComponent, y=deconstruct_vector.YComponent, Expression="Abs(y) < Abs(x)")
list = ClusterInput()
cull_pattern = CullPattern(List=list, CullPattern=expression)
join_curves = JoinCurves(Curves=flatten(cull_pattern), Preserve=False)
curve = ClusterInput()
curve_middle = CurveMiddle(Curve=curve)  # -> graft(Midpoint)
curve_middle_2 = CurveMiddle(Curve=join_curves)
distance = Distance(PointA=curve_middle_2, PointB=curve_middle)
sort_list = SortList(Keys=distance, ValuesValuesA=join_curves)  # -> Keys, ValuesValuesA
list_item = ListItem(List=sort_list.ValuesValuesA, Index=0, Wrap=True)
control_points = ControlPoints(Curve=list_item)  # -> Points, Weights, Knots
points = ClusterOutput(control_points.Points)

# ==== cluster Cluster

mesh = ClusterInput()
mesh_2 = ClusterInput()

mesh_edges = MeshEdges(Mesh=mesh)  # -> NakedEdges, InteriorEdges, NonManifoldEdges
mesh_edges_2 = MeshEdges(Mesh=mesh_2)  # -> NakedEdges, InteriorEdges, NonManifoldEdges
length = Length(Curve=mesh_edges.InteriorEdges)
length_2 = Length(Curve=mesh_edges_2.InteriorEdges)
division = Division(A=length, B=length_2)
bounds = Bounds(Numbers=division)
deconstruct_domain = DeconstructDomain(Domain=bounds)  # -> Start, End

interior_edges = ClusterOutput(mesh_edges_2.InteriorEdges)
result = ClusterOutput(division)
start = ClusterOutput(deconstruct_domain.Start)
end = ClusterOutput(deconstruct_domain.End)
