# Grasshopper definition knit_pattern_generation.gh (Grasshopper 1.0.7)

# ---- group: CLICK to duplicate image
trigger = Trigger(Interval=-1000, TimerInterval=1000, Target=filename)

# ---- group: Pattern inputs
image_size_x = Slider(100, range=0..500)
image_size_y = Slider(120, range=0..500)
float_count = Slider(5, range=0..10)

# ----
path = GhPythonScript()  # -> color_settings, OUTPUT
# ---------- path: Python ----------
import os

HERE = os.path.dirname(ghdoc.Path)
INPUT = os.path.abspath(os.path.join(HERE, "..", "input"))
OUTPUT = os.path.abspath(os.path.join(HERE, "..", "output"))
color_settings = os.path.abspath(os.path.join(INPUT, "color_settings.json"))
# ---------- end path ----------

# ---- group: Image inputs
panel = Panel("my-pattern")

# ---- group: Create pattern as mesh
create_colored_mesh = CreateColoredMesh(image_width=image_size_x, image_height=image_size_y, float_count=float_count, color_mapping_filepath=path.color_settings)

# ---- group: Image location data
filename = GhPythonScript(pattern_name=panel)  # -> out, filename
# ---------- filename: Python ----------
"""Creates a filename with a timestamp.
    Inputs:
        pattern_name: The name of the pattern
    Output:
        filename: The name of the exported pattern file"""

__author__ = "nikolechr"

from datetime import datetime

datestr = datetime.now().strftime("%d%m%Y-%H%M%S")
filename = "{}_{}.bmp".format(pattern_name, datestr)
# ---------- end filename ----------

# ---- group: Display colored mesh
mesh = Mesh(create_colored_mesh)

# ---- group: Export image
export_pattern_as_image = ExportPatternAsImage(
    colored_mesh=create_colored_mesh,
    image_width=image_size_x,
    image_height=image_size_y,
    image_folder=path.OUTPUT,
    image_filename=filename.filename)

# ==== cluster CreateColoredMesh
image_width = ClusterInput()
image_height = ClusterInput()
float_count = ClusterInput()
color_mapping_filepath = ClusterInput()
image_height_2 = Integer(image_height)
image_width_2 = Integer(image_width)

# ---- group: Pattern colors as 1D array
color_mapping_filepath_2 = FilePath(color_mapping_filepath)
float_count_2 = Integer(float_count)
python = GhPythonScript(color_mapping_filepath=color_mapping_filepath_2)  # -> out, color_mapping
# ---------- python: Python ----------
"""Retrieves a color mapping dictionary from a JSON file.
    Inputs:
        color_mapping_filepath: Path to the JSON file containing the color mapping dictionary
    Output:
        color_mapping: The color mapping dictionary"""

__author__ = "nikolechr"

import json
from System.Drawing import Color

with open(color_mapping_filepath, "r") as file:
    color_mapping = [{k:Color.FromArgb(*v) for k, v in json.load(file).items()}]
# ---------- end python ----------
python_2 = GhPythonScript(image_width=image_width_2, image_height=image_height_2, float_count=float_count_2, color_mapping=python.color_mapping)  # -> out, pattern_colors; inputs image_width: Int32, image_height: Int32, float_count: Int32
# ---------- python_2: Python ----------
"""Generates a list of mesh colors based on pattern parameters.
    Inputs:
        image_width: Image width in pixels
        image_height: Image height in pixels
        float_count: Number of float columns between loop columns
        color_mapping: Knit operations to color mapping as a dictionary
    Output:
        pattern_colors: List (1D) of pattern colors, one for each mesh face"""

__author__ = "nikolechr"

step = float_count + 1

def get_color_from_position(row, column):
    if column % (2 * step) == 0:
        if row % 2 == 0:
            strop = "front_back"
        else:
            strop = "back_front"
    elif column % (2 * step) == step:
        if row % 2 == 0:
            strop = "back_front"
        else:
            strop = "front_back"
    else:
        strop = "float"
            
    return color_mapping[strop]

pattern_colors = [get_color_from_position(i, j) for i in range(image_height) for j in range(image_width)]
# ---------- end python_2 ----------

# ---- group: Base mesh
rectangle = Rectangle(Plane=PlaneXY(0, 0, 0), XSize=image_width_2, YSize=image_height_2, Radius=0)  # -> Rectangle, Length
mplane = MeshPlane(Boundary=rectangle.Rectangle, WidthCount=image_width_2, HeightCount=image_height_2)  # -> Mesh, Area

# ---- group: Colored mesh
python_3 = GhPythonScript(mesh=mplane.Mesh, colors=flatten(python_2.pattern_colors))  # -> out, colored_mesh; inputs mesh: Mesh, colors: list
# ---------- python_3: Python ----------
"""Unwelds and colors the faces of a mesh.
    Adapted from https://discourse.mcneel.com/t/color-mesh-faces-no-bleeding-best-practice/60299
    Original author: Anders Holden Deleuran
    Inputs:
        mesh: A base mesh to apply the colors on
        colors: Mesh face colors as an 1D list
    Output:
        colored_mesh: The mesh with colors per face"""

import Rhino as rc

def color_mesh_faces(mesh, colors):
    faces = mesh.Faces
    vertices = mesh.Vertices
    
    c_mesh = rc.Geometry.Mesh()
    face_id = 0
    
    for face, color in zip(faces, colors):
        c_mesh.Vertices.Add(vertices[face.A])
        c_mesh.Vertices.Add(vertices[face.B])
        c_mesh.Vertices.Add(vertices[face.C])
        c_mesh.VertexColors.Add(color)
        c_mesh.VertexColors.Add(color)
        c_mesh.VertexColors.Add(color)
        if face.IsQuad:
            c_mesh.Vertices.Add(vertices[face.D])
            c_mesh.VertexColors.Add(color)
        
        if face.IsQuad:
            c_mesh.Faces.AddFace(face_id, face_id + 1, face_id + 2, face_id + 3)
            face_id += 4
        elif face.IsTriangle:
            c_mesh.Faces.AddFace(face_id, face_id + 1, face_id + 2)
            face_id += 3
    return c_mesh

if mesh and colors:
    colored_mesh = color_mesh_faces(mesh, colors)
else:
    colored_mesh = []
# ---------- end python_3 ----------
colored_mesh = Mesh(python_3.colored_mesh)

# ----
colored_mesh_2 = ClusterOutput(colored_mesh)

# ==== cluster ExportPatternAsImage
colored_mesh = ClusterInput()

# ---- group: Prepare GDI+ shapes
colored_mesh_2 = Mesh(colored_mesh)
demesh = DeconstructMesh(Mesh=colored_mesh_2)  # -> Vertices, Faces, Colours, Normals
faceb = FaceBoundaries(Mesh=colored_mesh_2)
panel = Panel("""1
0
0
0""")
dispatch = Dispatch(List=demesh.Colours, DispatchPattern=panel)  # -> ListA, ListB

# ----
image_width = ClusterInput()
image_height = ClusterInput()
image_folder = ClusterInput()
image_filename = ClusterInput()
image_filename_2 = Text(image_filename)

# ---- group: Create image boundary
image_height_2 = Integer(image_height)
image_width_2 = Integer(image_width)
rectangle = Rectangle(Plane=PlaneXY(0, 0, 0), XSize=image_width_2, YSize=image_height_2, Radius=0)  # -> Rectangle, Length

# ---- group: Get image filepath
image_folder_2 = FilePath(image_folder)
merge = Merge(Data1=image_folder_2, Data2=image_filename_2)
join = TextJoin(Text=merge)

# ---- group: Create GDI+ shapes
fill = CreateGdiFill(Colour=dispatch.ListA)
shape = CreateGdiShape(Geometry=faceb, Fill=fill)  # -> flatten(Shape)

# ---- group: Draw image
draw = DrawImage(
    Shapes=shape,
    Size=rectangle.Rectangle,
    Factor=1,
    Background=RGBA(255, 255, 255, 0),
    AntiAlias=Toggle(False),
    FileLocation=join)
